# Grasshopper definition View_to_the_Outdoors_Through_a_Facade.gh (Grasshopper 1.0.7)

panel = Panel("https://climate.onebuilding.org/WMO_Region_4_North_and_Central_America/USA_United_States_of_America/FL_Florida/USA_FL_NAS.Jacksonville-Towers.Field.722065_TMY3.zip")
analysisperiod = LBAnalysisPeriod(start_month="1", start_day="1", start_hour=0, end_month="12", end_day="31")  # -> period, hoys, dates; plug-in component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
downloadepw = LBDownloadWeather(weather_URL=panel)  # -> epw_file, stat_file, ddy_file; plug-in component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

facade_geometry3 = Brep([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])
# Facade
# Options
facade_geometry1 = Brep([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])
facade_geometry2 = Brep([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])

importloc = LBImportLocation(epw_file=downloadepw.epw_file)  # -> location; plug-in component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

opaque_geometry = Brep(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)
grid_size = Panel("0.25")
# Other
# Inputs
test_surface = Brep(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)

facade_geometry = Brep(facade_geometry3)
deconstruct_brep = DeconstructBrep(Brep=facade_geometry)  # -> Faces, Edges, Vertices
sunpath = LBSunPath(location=importloc, hoys=analysisperiod.hoys, scale=Slider(0.5, range=0..1))  # -> out, vectors, altitudes, azimuths, hoys, sun_pts, analemma, daily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; plug-in component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
geometry = Geometry([deconstruct_brep.Edges, deconstruct_brep.Faces])
visibilitypercent = LBVisibilityPercent(
    view_points=sunpath.sun_pts,
    geometry=flatten(test_surface),
    context=flatten([facade_geometry, opaque_geometry]),
    grid_size=grid_size,
    run=Toggle(True))  # -> out, points, results, mesh, legend, title, int_mtx; plug-in component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
