# Grasshopper definition apply_metadata.gh (Grasshopper 1.0.8)
# plug-ins: LadybugGrasshopper

# ----
# Sample-2:
# 
# Comparison of the old and new processes
panel = Panel("4")
domain_box = DomainBox(Base=PlaneXY(0, 0, 0), X=panel, Y=panel, Z=panel)
panel_2 = Panel("https://climate.onebuilding.org/WMO_Region_2_Asia/CHN_China/SH_Shanghai/CHN_SH_Shanghai-Hongqiao.Intl.AP.583670_TMYx.zip")
roomsolid = HBRoomFromSolid(geo=flatten(domain_box), name="Test_Room", conditioned=True)  # -> out, rooms; plug-in component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
simoutput = HBSimulationOutput(surface_temperature=Toggle(True))  # -> out, sim_output; plug-in component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
downloadepw = LBDownloadWeather(weather_URL=panel_2)  # -> epw_file, stat_file, ddy_file; plug-in component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
model = HBModel(rooms=flatten(roomsolid.rooms), name="Test_Model")  # -> out, model; plug-in component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
simpar = HBSimulationParameter(output=simoutput.sim_output, timestep=6)  # -> sim_par; plug-in component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
lb_falsestart_toggle = LBFalseStartToggle(True)
modeltoosm = HBModelToOSM(model=model.model, epw_file=downloadepw.epw_file, sim_par=simpar, write=lb_falsestart_toggle, run=lb_falsestart_toggle)  # -> out, jsons, osw, osm, idf, sql, zsz, rdd, html; plug-in component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
facesbytype = HBFacesByType(hb_objs=model.model)  # -> walls, interior_walls, roofs, ceilings, exterior_floors, interior_floors, air_walls, apertures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; plug-in component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
faceresult = HBReadFaceResult(sql=modeltoosm.sql)  # -> face_indoor_temp, face_outdoor_temp, face_energy_flow; plug-in component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
hb_face_attributes = HBFaceAttributes({"Display Name": "display_name", "Simulation Name (Identifier)": "identifier", "Boundary Condition": "boundary_condition", "Has Parent": "has_parent", "Parent": "parent", "Azimuth": "azimuth", "Altitude": "altitude", "Area": "area", "Perimeter": "perimeter", "Face Type": "type", "Aperture Is Operable": "is_operable", "Door Is Glass": "is_glass"}, selected="Azimuth")
faceresultbytype = HBFaceResultByType(data=faceresult.face_outdoor_temp, hb_objs=facesbytype.walls)  # -> walls, interior_walls, roofs, ceilings, exterior_floors, interior_floors, apertures, interior_apertures, doors, interior_doors; plug-in component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
lablefaces = HBLabelFaces(hb_objs=flatten(facesbytype.walls), attribute=hb_face_attributes)  # -> label_text, base_pts, labels, wire_frame; plug-in component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

# ----
# Sample-1:
# 
# Main input and output tests.
# Type: * will affect the display of the Legend Categorized section in the LB Monthly Chart.
# 
# When comparing the same type of data sets from multiple sources simultaneously,
# 
# it is usually necessary to use an additional type:* identifier for the graph.(eg. room display name)
panel_3 = Panel("""source: TMY
city: Beijing
country: USA""")
constrheader = LBConstructHeader(data_type="temperature", metadata=panel_3)  # -> header; plug-in component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
series = Series(Start=0, Step=1, Count="8760")
data = LBConstructData(header=constrheader, values=series)  # -> data; plug-in component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
applymeta = LBApplyMetadata(data=data, metadata="type:Room_1", override=Toggle(False))  # -> data; plug-in component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
construct_point = ConstructPoint(XCoordinate=0, YCoordinate="150", ZCoordinate=0)
monthlychart = LBMonthlyChart(data=applymeta, base_pt=construct_point)  # -> out, data_mesh, data_lines, col_lines, legend, borders, labels, y_title, title, vis_set; plug-in component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
hourlyplot = LBHourlyPlot(data=applymeta)  # -> out, mesh, legend, borders, labels, title, vis_set; plug-in component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

# ----
# Sample-3:
# 
# The application that binds data to the hbobject is very useful when
# 
# visualizing the electricity generation of PV (it would be even better if Shade could also be integrated).
hb_face_attributes_2 = HBFaceAttributes({"Display Name": "display_name", "Simulation Name (Identifier)": "identifier", "Boundary Condition": "boundary_condition", "Has Parent": "has_parent", "Parent": "parent", "Azimuth": "azimuth", "Altitude": "altitude", "Area": "area", "Perimeter": "perimeter", "Face Type": "type", "Aperture Is Operable": "is_operable", "Door Is Glass": "is_glass"}, selected="Simulation Name (Identifier)")
face = Data(facesbytype.walls)
lablefaces_2 = HBLabelFaces(hb_objs=face, attribute=hb_face_attributes_2)  # -> label_text, base_pts, labels, wire_frame; plug-in component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
concatenate = Concatenate(FragmentA="Surface:", FragmentB=lablefaces_2.label_text)
data_2 = Data(faceresultbytype.walls)
applymeta_2 = LBApplyMetadata(data=data_2, metadata=concatenate)  # -> data; plug-in component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
colorfaces = HBColorFaces(data=flatten(applymeta_2), hb_objs=flatten(face))  # -> readMe, mesh, wire_frame, legend, title, faces, colors, values, vis_set; plug-in component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

# ----
# This process is used to illustrate the complexity that arises when using the old method,
# 
# which involves too many components.
# 
# Furthermore, regarding the specific field usage of metadata in this case, I also mentioned it.
panel_4 = Panel("Surface:")
concatenate_2 = Concatenate(FragmentA=panel_4, FragmentB=lablefaces_2.label_text)
python_3_script = Python3Script(identifier=lablefaces_2.label_text)  # -> identifier_upper
# ---------- python_3_script: Python ----------
identifier_upper = identifier.upper()
# ---------- end python_3_script ----------
panel_5 = Panel(concatenate_2)
data_3 = Data(faceresultbytype.walls)
data_4 = Data(faceresultbytype.walls)
concatenate_3 = Concatenate(FragmentA="Surface:", FragmentB=python_3_script)
xdata = LBDeconstructData(data=data_4)  # -> header, values; plug-in component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
xdata_2 = LBDeconstructData(data=data_3)  # -> header, values; plug-in component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
graft_tree = GraftTree(Tree=xdata.header, IncludeEmptyLists=True, IncludeNullItems=True)
graft_tree_2 = GraftTree(Tree=xdata_2.header, IncludeEmptyLists=True, IncludeNullItems=True)
panel_6 = Panel(concatenate_3)
graft_tree_3 = GraftTree(Tree=concatenate_3, IncludeEmptyLists=True, IncludeNullItems=True)
graft_tree_4 = GraftTree(Tree=concatenate_2, IncludeEmptyLists=True, IncludeNullItems=True)
xheader = LBDeconstructHeader(header=graft_tree)  # -> data_type, unit, a_period, metadata; plug-in component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
xheader_2 = LBDeconstructHeader(header=graft_tree_2)  # -> data_type, unit, a_period, metadata; plug-in component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
simplify_tree = SimplifyTree(Tree=xheader.metadata, Front=False)
simplify_tree_2 = SimplifyTree(Tree=graft_tree_3, Front=False)
simplify_tree_3 = SimplifyTree(Tree=xheader_2.metadata, Front=False)
simplify_tree_4 = SimplifyTree(Tree=graft_tree_4, Front=False)
merge = Merge(Data1=simplify_tree, Data2=simplify_tree_2)
merge_2 = Merge(Data1=simplify_tree_3, Data2=simplify_tree_4)
constrheader_2 = LBConstructHeader(data_type=xheader.data_type, unit=xheader.unit, a_period=xheader.a_period, metadata=merge)  # -> header; plug-in component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
constrheader_3 = LBConstructHeader(data_type=xheader_2.data_type, unit=xheader_2.unit, a_period=xheader_2.a_period, metadata=merge_2)  # -> header; plug-in component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
data_5 = LBConstructData(header=constrheader_2, values=xdata.values)  # -> data; plug-in component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
data_6 = LBConstructData(header=constrheader_3, values=xdata_2.values)  # -> data; plug-in component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
faces = Data(face)
faces_2 = Data(face)
colorfaces_2 = HBColorFaces(data=flatten(data_5), hb_objs=flatten(faces_2))  # -> readMe, mesh, wire_frame, legend, title, faces, colors, values, vis_set; plug-in component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
colorfaces_3 = HBColorFaces(data=flatten(data_6), hb_objs=flatten(faces))  # -> readMe, mesh, wire_frame, legend, title, faces, colors, values, vis_set; plug-in component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
panel_7 = Panel(colorfaces_2.readMe)
panel_8 = Panel(colorfaces_3.readMe)

timeop = LBTimeIntervalOperation(data=faceresultbytype.walls)  # -> daily, monthly, mon_per_hr; plug-in component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
concatenate_4 = Concatenate(FragmentA="type:Face_Azimuth_", FragmentB=lablefaces.label_text)
graft_tree_5 = GraftTree(Tree=timeop.mon_per_hr, IncludeEmptyLists=True, IncludeNullItems=True)
graft_tree_6 = GraftTree(Tree=concatenate_4, IncludeEmptyLists=True, IncludeNullItems=True)
applymeta_3 = LBApplyMetadata(data=graft_tree_5, metadata=graft_tree_6)  # -> data; plug-in component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
flatten_tree = FlattenTree(Tree=applymeta_3, Path="{0}")

# ----
# Old process:
# 
# In this process, I represent the possible manual inputs or additional data processing by handling various components of the data structure.
xdata_3 = LBDeconstructData(data=faceresultbytype.walls)  # -> header, values; plug-in component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
graft_tree_7 = GraftTree(Tree=xdata_3.header, IncludeEmptyLists=True, IncludeNullItems=True)
xheader_3 = LBDeconstructHeader(header=graft_tree_7)  # -> data_type, unit, a_period, metadata; plug-in component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
simplify_tree_5 = SimplifyTree(Tree=xheader_3.metadata, Front=False)
simplify_tree_6 = SimplifyTree(Tree=graft_tree_6, Front=False)
merge_3 = Merge(Data1=simplify_tree_5, Data2=simplify_tree_6)
constrheader_4 = LBConstructHeader(data_type=xheader_3.data_type, unit=xheader_3.unit, a_period=xheader_3.a_period, metadata=merge_3)  # -> header; plug-in component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
data_7 = LBConstructData(header=constrheader_4, values=xdata_3.values)  # -> data; plug-in component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
timeop_2 = LBTimeIntervalOperation(data=data_7)  # -> daily, monthly, mon_per_hr; plug-in component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
flatten_tree_2 = FlattenTree(Tree=timeop_2.mon_per_hr, Path="{0}")
monthlychart_2 = LBMonthlyChart(data=flatten_tree_2)  # -> out, data_mesh, data_lines, col_lines, legend, borders, labels, y_title, title, vis_set; plug-in component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

# ----
# New process: Simple and effective
monthlychart_3 = LBMonthlyChart(data=flatten_tree)  # -> out, data_mesh, data_lines, col_lines, legend, borders, labels, y_title, title, vis_set; plug-in component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
