# Grasshopper definition comfort_shade_benefit.gh (Grasshopper 1.0.7)

# ----
# Import Weather Data
panel = Panel("https://energyplus-weather.s3.amazonaws.com/north_and_central_america_wmo_region_4/USA/NY/USA_NY_New.York-J.F.Kennedy.Intl.AP.744860_TMY3/USA_NY_New.York-J.F.Kennedy.Intl.AP.744860_TMY3.zip")
downloadepw = LBDownloadWeather(weather_URL=panel)  # -> epw_file, stat_file, ddy_file; plug-in component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
importepw = LBImportEPW(epw_file=downloadepw.epw_file)  # -> location, dry_bulb_temperature, dew_point_temperature, relative_humidity, wind_speed, wind_direction, direct_normal_rad, diffuse_horizontal_rad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; plug-in component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

crv = Curve([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])
preview = CustomPreview(Geometry=crv, Shader=ColourSwatch(SwatchColor=RGB(0, 0, 0)))

# ----
# Calculate Solar Adjusted MRT
toggle = BooleanToggle(True)
outdoorsolarmrt = LBOutdoorSolarMRT(
    location=importepw.location,
    surface_temp=importepw.dry_bulb_temperature,
    dir_norm_rad=importepw.direct_normal_rad,
    diff_horiz_rad=importepw.diffuse_horizontal_rad,
    horiz_infrared=importepw.horizontal_infrared_rad,
    run=toggle)  # -> report, short_erf, long_erf, short_dmrt, long_dmrt, mrt; plug-in component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

# ----
# Comfort In the Sun
toggle_2 = BooleanToggle(True)
utci = LBUTCIComfort(
    air_temp=importepw.dry_bulb_temperature,
    mrt=outdoorsolarmrt.mrt,
    rel_humid=importepw.relative_humidity,
    wind_vel=importepw.wind_speed,
    run=toggle_2)  # -> report, utci, comfort, condition, category, comf_obj; plug-in component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

# ----
# Comfort In the Shade
toggle_3 = BooleanToggle(True)
utci_2 = LBUTCIComfort(
    air_temp=importepw.dry_bulb_temperature,
    rel_humid=importepw.relative_humidity,
    wind_vel=importepw.wind_speed,
    run=toggle_3)  # -> report, utci, comfort, condition, category, comf_obj; plug-in component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

# ----
# Calculate Shade
# Benefit and Harm
toggle_4 = BooleanToggle(False)
busstop_seat = Brep(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)
busstop_shade = Brep(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)
thermalshadebenefit = LBThermalShadeBenefit(
    location=importepw.location,
    temperature=utci.utci,
    study_region=busstop_seat,
    shade_geo=busstop_shade,
    grid_size="0.15",
    timestep="4",
    run=toggle_4)  # -> report, vectors, points, mesh, legend, title, shade_help, shade_harm, shade_net; plug-in component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

# ----
# Compare Comfort
# In the Sun vs. Shade
pt = Point(Point(88.47226712, 166.2122937, 0))
hourlyplot = LBHourlyPlot(data=[utci_2.condition, utci.condition], base_pt=pt)  # -> report, mesh, legend, borders, labels, title, vis_set; plug-in component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

# ----
# Understand the Potential of Shade
panel_2 = Panel("26")
hdd_cdd = LBDegreeDays(dry_bulb=utci.utci, heat_base="9", cool_base=panel_2)  # -> hourly_heat, hourly_cool, heat_deg_days, cool_deg_days; plug-in component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
maximum_degc_days_to_harm = Panel(hdd_cdd.heat_deg_days)
maximum_degc_days_to_improve = Panel(hdd_cdd.cool_deg_days)

# ----
# Pull Out The Areas Where Shade is Most Desirable
number_slider = Slider(24, range=0..100)
meshselector = LBMeshThresholdSelector(values=thermalshadebenefit.shade_net, mesh=thermalshadebenefit.mesh, pct_threshold=number_slider)  # -> report, total_value, total_area, sub_mesh, outline; plug-in component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
area_of_the_shade_m2 = Panel(meshselector.total_area)
net_degc_days_improved_by_shade = Panel(meshselector.total_value)
