# Grasshopper definition conditional_statement_to_filter_weather_data.gh (Grasshopper 1.0.7)
# Copyright: I'll just come fight ya lawyers are tedious

panel = Panel("https://climate.onebuilding.org/WMO_Region_4_North_and_Central_America/USA_United_States_of_America/FL_Florida/USA_FL_NAS.Jacksonville-Towers.Field.722065_TMY3.zip")
downloadepw = LBDownloadWeather(weather_URL=panel)  # -> epw_file, stat_file, ddy_file; plug-in component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
importepw = LBImportEPW(epw_file=downloadepw.epw_file)  # -> location, dry_bulb_temperature, dew_point_temperature, relative_humidity, wind_speed, wind_direction, direct_normal_rad, diffuse_horizontal_rad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; plug-in component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
hourlyplot = LBHourlyPlot(data=[importepw.dry_bulb_temperature, importepw.relative_humidity], statement="18 < a < 22 and b<80")  # -> out, mesh, legend, borders, labels, title, vis_set; plug-in component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
