# Grasshopper definition estimate_glare_potential_over_a_year.gh (Grasshopper 1.0.7)

panel = Panel("https://energyplus-weather.s3.amazonaws.com/north_and_central_america_wmo_region_4/USA/FL/USA_FL_Jacksonville.NAS.722065_TMY3/USA_FL_Jacksonville.NAS.722065_TMY3.zip")
downloadepw = LBDownloadWeather(weather_URL=panel)  # -> epw_file, stat_file, ddy_file; plug-in component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
analysisperiod = LBAnalysisPeriod(start_month=1, start_day=1, start_hour=0)  # -> period, hoys, dates; plug-in component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
importloc = LBImportLocation(epw_file=downloadepw.epw_file)  # -> location; plug-in component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
sunpath = LBSunPath(location=importloc, hoys=analysisperiod.hoys, scale="0.08")  # -> out, vectors, altitudes, azimuths, hoys, sun_pts, analemma, daily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; plug-in component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
geometry = Geometry([sunpath.analemma, sunpath.compass, sunpath.daily, sunpath.title, sunpath.legend])

colrange = LBColorRange(index="6")  # -> colors; plug-in component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
legendpar = LBLegendParameters(colors=colrange)  # -> leg_par; plug-in component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

opaque_geometry = Brep([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])
run = BooleanToggle(True)
test_surface = Brep(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)
directsunhours = LBDirectSunHours(
    vectors=flatten(sunpath.vectors),
    geometry=flatten(test_surface),
    context=flatten(opaque_geometry),
    grid_size="0.25",
    legend_par=legendpar,
    run=run)  # -> out, points, results, mesh, legend, title, int_mtx; plug-in component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

xmatrix = LBDeconstructMatrix(matrix=flatten(directsunhours.int_mtx))  # -> values; plug-in component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
list_length = ListLength(List=directsunhours.points)
flip_matrix = FlipMatrix(Data=xmatrix)
ma = MassAddition(Input=flip_matrix)  # -> flatten(Result), PartialResults
division = Division(A=ma.Result, B=list_length)
multiplication = Multiplication(A=division, B="100")

subtraction = Subtraction(A=sunpath.hoys, B="1")
dup = DuplicateData(Data="0", Number="8760", Order=True)
constrtype = LBConstructDataType(name="Percent of Floor in Direct Sun", unit="Typeless")  # -> type; plug-in component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
constrheader = LBConstructHeader(data_type=constrtype)  # -> header; plug-in component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
replace_items = ReplaceItems(List=dup, Item=multiplication, Indices=subtraction, Wrap=False)
data = LBConstructData(header=constrheader, values=replace_items)  # -> data; plug-in component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

hourlyplot = LBHourlyPlot(data=data, base_pt="10,0,0", x_dim="0.01", y_dim="0.1", legend_par=legendpar)  # -> out, mesh, legend, borders, labels, title, vis_set; plug-in component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
