# Grasshopper definition filter_annual_weather_data_based_on_analysis_period.gh (Grasshopper 1.0.7)
# Copyright: I'll just come fight ya lawyers are tedious

panel = Panel("https://climate.onebuilding.org/WMO_Region_4_North_and_Central_America/USA_United_States_of_America/FL_Florida/USA_FL_NAS.Jacksonville-Towers.Field.722065_TMY3.zip")
downloadepw = LBDownloadWeather(weather_URL=panel)  # -> epw_file, stat_file, ddy_file; plug-in component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
importepw = LBImportEPW(epw_file=downloadepw.epw_file)  # -> location, dry_bulb_temperature, dew_point_temperature, relative_humidity, wind_speed, wind_direction, direct_normal_rad, diffuse_horizontal_rad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; plug-in component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
analysisperiod = LBAnalysisPeriod(start_month="1", start_day="1", start_hour=0, end_month="4", end_day="31")  # -> period, hoys, dates; plug-in component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
applyper = LBApplyAnalysisPeriod(data=importepw.direct_normal_rad, period=analysisperiod.period)  # -> data; plug-in component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
hourlyplot = LBHourlyPlot(data=applyper, z_dim="20")  # -> out, mesh, legend, borders, labels, title, vis_set; plug-in component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
