# Grasshopper definition glare_shade_benefit.gh (Grasshopper 1.0.7)

# ----
# Get Sun Vectors to Block
panel = Panel("https://energyplus-weather.s3.amazonaws.com/north_and_central_america_wmo_region_4/USA/NY/USA_NY_New.York-J.F.Kennedy.Intl.AP.744860_TMY3/USA_NY_New.York-J.F.Kennedy.Intl.AP.744860_TMY3.zip")
downloadepw = LBDownloadWeather(weather_URL=panel)  # -> epw_file, stat_file, ddy_file; plug-in component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
analysisperiod = LBAnalysisPeriod(start_month=1, start_day=1, start_hour=0, timestep="6")  # -> period, hoys, dates; plug-in component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
importloc = LBImportLocation(epw_file=downloadepw.epw_file)  # -> location; plug-in component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
sunpath = LBSunPath(location=importloc, hoys=analysisperiod.hoys, scale="0.25")  # -> report, vectors, altitudes, azimuths, hoys, sun_pts, analemma, daily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; plug-in component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

geo = Geometry(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)
preview = CustomPreview(Geometry=geo, Material=ColourSwatch(SwatchColor=RGB(0, 0, 0)))

# ----
# Get Sun Vectors to Block
panel_2 = Panel("https://energyplus-weather.s3.amazonaws.com/north_and_central_america_wmo_region_4/USA/NY/USA_NY_New.York-J.F.Kennedy.Intl.AP.744860_TMY3/USA_NY_New.York-J.F.Kennedy.Intl.AP.744860_TMY3.zip")
downloadepw_2 = LBDownloadWeather(weather_URL=panel_2)  # -> epw_file, stat_file, ddy_file; plug-in component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
hoy = LBCalculateHOY(month=Slider(8, range=1..12), hour=Slider(10, range=0..23))  # -> flatten(hoy), flatten(doy), flatten(date); plug-in component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
importloc_2 = LBImportLocation(epw_file=downloadepw_2.epw_file)  # -> location; plug-in component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
sunpath_2 = LBSunPath(location=importloc_2, hoys=hoy.hoy, scale="0.1")  # -> report, vectors, altitudes, azimuths, hoys, sun_pts, analemma, daily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; plug-in component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
sph = Sphere(Base=sunpath_2.sun_pts, Radius="0.25")

# ----
# Evaluate All Sun on the
# Cooling Design Day
panel_3 = Panel("8")
analysisperiod_2 = LBAnalysisPeriod(start_month=panel_3, start_day="21", start_hour=0, end_month=panel_3, end_day="21")  # -> period, hoys, dates; plug-in component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

# ----
# Study Shade Benefit to
# Glare for a Single View
geo_2 = Geometry(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)
pt = Point(Point(2.5, 0.3162992699, 1.7376125))
geo_3 = Geometry(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)
vec = Vector(Vector(0, -0.6002275249, 0))
shadebenefit = LBShadeBenefit(
    vectors=sunpath.vectors,
    study_points=pt,
    study_directs=vec,
    shade_geo=geo_3,
    context=geo_2,
    grid_size="0.2",
    timestep="6",
    run=Toggle(False))  # -> report, mesh, legend, title, shade_help; plug-in component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
vdis = VectorDisplay(Anchor=pt, Vector=vec)

# ----
# Study Shade Benefit to
# Peak Cooling on a Window
# Using Design Day Sun Positions
panel_4 = Panel("0.1")
geo_4 = Geometry(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)
genpts = LBGeneratePointGrid(geometry=geo_4, grid_size=panel_4)  # -> points, vectors, face_areas, mesh; plug-in component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
multiplication = Multiplication(A=panel_4, B="2")
geo_5 = Geometry(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)
shadebenefit_2 = LBShadeBenefit(
    vectors=sunpath_2.vectors,
    study_points=genpts.points,
    study_directs=genpts.vectors,
    shade_geo=geo_5,
    grid_size=multiplication,
    run=Toggle(False))  # -> report, mesh, legend, title, shade_help; plug-in component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

# ----
# Pull Out The Areas Where Shade is Most Desirable
number_slider = Slider(50, range=0..100)
meshselector = LBMeshThresholdSelector(values=shadebenefit.shade_help, mesh=shadebenefit.mesh, pct_threshold=number_slider)  # -> report, total_value, total_area, sub_mesh, outline; plug-in component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
shade_area = Panel(meshselector.total_area)
number_of_hours_blocked = Panel(meshselector.total_value)

# ----
# Pull Out The Areas Where Shade is Most Desirable
meshselector_2 = LBMeshThresholdSelector(values=shadebenefit_2.shade_help, mesh=shadebenefit_2.mesh, abs_threshold="0.01")  # -> report, total_value, total_area, sub_mesh, outline; plug-in component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
number_of_hours_blocked_2 = Panel(meshselector_2.total_value)
shade_area_2 = Panel(meshselector_2.total_area)
