# Grasshopper definition grid_of_monthly_wind_roses.gh (Grasshopper 1.0.7)

panel = Panel("https://energyplus-weather.s3.amazonaws.com/north_and_central_america_wmo_region_4/USA/MA/USA_MA_Boston-Logan.725090_TMY2/USA_MA_Boston-Logan.725090_TMY2.zip")
downloadepw = LBDownloadWeather(weather_URL=panel)  # -> epw_file, stat_file, ddy_file; plug-in component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
importepw = LBImportEPW(epw_file=downloadepw.epw_file)  # -> location, dry_bulb_temperature, dew_point_temperature, relative_humidity, wind_speed, wind_direction, direct_normal_rad, diffuse_horizontal_rad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; plug-in component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

# ---- group: Standardize Legend Parameters for All 12 Roses
panel_2 = Panel("0")
panel_3 = Panel("10")
panel_4 = Panel("0")
data = Data([ColourSwatch(SwatchColor=RGB(255, 255, 255)), ColourSwatch(SwatchColor=RGB(255, 255, 153)), ColourSwatch(SwatchColor=RGB(0, 255, 229)), ColourSwatch(SwatchColor=RGB(0, 64, 255)), ColourSwatch(SwatchColor=RGB(0, 25, 99))])
legendpar = LBLegendParameters(min=panel_2, max=panel_3, colors=data, num_decimals=panel_4)  # -> leg_par; plug-in component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

# ---- group: Create Analysis Periods for Each Month
series = Series(Start="1", Step=1, Count="12")
analysisperiod = LBAnalysisPeriod(start_month=series, start_day=1, start_hour=0, end_month=series)  # -> simplify(graft(period)), hoys, dates; plug-in component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

# ---- group: Create a Grid of Points for Locating Wind Roses
sqgrid = Square(Plane=PlaneXY(0, 0, 0), Size="700", ExtentX="3", ExtentY="2")  # -> Cells, Points
rev = ReverseList(List=sqgrid.Points)  # -> flatten(List)
pt = Point(simplify(graft(rev)))

# ---- group: Create One Legend for All Roses
legendpar_2 = LBLegendParameters(
    colors=data,
    continuous_leg=Toggle(True),
    num_decimals=panel_4,
    vert_or_horiz=Toggle(False),
    seg_height="80",
    seg_width="150",
    text_height="40")  # -> leg_par; plug-in component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
data_2 = Data([panel_2, panel_3])
createlegend = LBCreateLegend(values=data_2, base_plane="2350, 1800, 0", title="Wind Speed (m/2)", legend_par=legendpar_2)  # -> mesh, title_obj, label_objs, label_text, colors; plug-in component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
medges = MeshEdges(Mesh=createlegend.mesh)  # -> NakedEdges, InteriorEdges, NonManifoldEdges
preview = CustomPreview(Geometry=[medges.NakedEdges, medges.InteriorEdges], Material=ColourSwatch(SwatchColor=RGB(0, 0, 0)))

# ---- group: Create Monthly Labels for the Wind Roses
panel_5 = Panel("""Jan
Feb
Mar
Apr
May
Jun
Jul
Aug
Sep
Oct
Nov
Dec""")
move = Move(Geometry=rev, Motion="-40, -340, 0")  # -> Geometry, Transform
tag = TextTag3D(Location=move.Geometry, Text=panel_5, Size="35", Colour=ColourSwatch(SwatchColor=RGB(0, 0, 0)), Justification=7)

# ---- group: Plot Wind Roses
windrose = LBWindRose(
    data=importepw.wind_speed,
    wind_direction=importepw.wind_direction,
    dir_count="18",
    center_pt=pt,
    freq_dist="20",
    freq_hours="10",
    max_freq_lines="12",
    legend_par=legendpar,
    period=analysisperiod.period)  # -> report, mesh, compass, orient_line, freq_line, windrose_line, legend, title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; plug-in component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
move_2 = Move(Geometry=windrose.mesh, Motion="0, 0, 1")  # -> Geometry, Transform
geo = Geometry([windrose.compass, windrose.orient_line, windrose.freq_line, windrose.windrose_line])
