# Grasshopper definition radiation_benefit_on_sunpath.gh (Grasshopper 1.0.7)

# ----
# Download and Import EPW
panel = Panel("https://www.energyplus.net/weather-download/north_and_central_america_wmo_region_4/USA/MA/USA_MA_Boston-Logan.Intl.AP.725090_TMY3/all")
downloadepw = LBDownloadWeather(weather_URL=panel)  # -> epw_file, stat_file, ddy_file; plug-in component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
importepw = LBImportEPW(epw_file=downloadepw.epw_file)  # -> location, dry_bulb_temperature, dew_point_temperature, relative_humidity, wind_speed, wind_direction, direct_normal_rad, diffuse_horizontal_rad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; plug-in component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

# ----
# Select Helpful/Harmful Conditions
# Using Air Temperature
building_balance_point = Slider(15, range=10..20)
xdata = LBDeconstructData(data=importepw.dry_bulb_temperature)  # -> header, values; plug-in component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
larger = LargerThan(FirstNumber=xdata.values, SecondNumber=building_balance_point)  # -> LargerThan, OrEqualTo
series = Series(Start=0, Step=1, Count="8760")
dispatch = Dispatch(List=series, DispatchPattern=larger.LargerThan)  # -> ListA, ListB

# ---- group: Helpful Radiation
skymatrix = LBCumulativeSkyMatrix(
    location=importepw.location,
    direct_rad=importepw.direct_normal_rad,
    diffuse_rad=importepw.diffuse_horizontal_rad,
    hoys=dispatch.ListB)  # -> report, sky_mtx; plug-in component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

# ---- group: Harmful Radiation
skymatrix_2 = LBCumulativeSkyMatrix(
    location=importepw.location,
    direct_rad=importepw.direct_normal_rad,
    diffuse_rad=importepw.diffuse_horizontal_rad,
    hoys=dispatch.ListA)  # -> report, sky_mtx; plug-in component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

# ----
# Subtract Helpful Radiation from Harmful Radiation
xmatrix = LBDeconstructMatrix(matrix=skymatrix.sky_mtx)  # -> values; plug-in component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
xmatrix_2 = LBDeconstructMatrix(matrix=skymatrix_2.sky_mtx)  # -> values; plug-in component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
bang = ExplodeTree(Data=simplify(xmatrix_2))  # -> Branch0, Branch1, Branch2
bang_2 = ExplodeTree(Data=simplify(xmatrix))  # -> Branch0, Branch1, Branch2
subtraction = Subtraction(A=bang.Branch1, B=bang_2.Branch1)
subtraction_2 = Subtraction(A=bang.Branch2, B=bang_2.Branch2)
data = Data([bang.Branch0, subtraction, subtraction_2])
matrix = LBConstructMatrix(values=data)  # -> matrix; plug-in component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

# ----
# Legend for Radiation Dome
panel_2 = Panel("12")
colrange = LBColorRange(index=panel_2)  # -> colors; plug-in component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
neg = Negative(Value="25")
legendpar = LBLegendParameters(min=neg, max="25", colors=colrange, num_decimals="0")  # -> leg_par; plug-in component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

pt = Point(Point(209.9418744, 195.2042226, 0))

# ----
# Shading Mask for Context
brep = Brep([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])
edges = BrepEdges(Brep=brep)  # -> Naked, Interior, NonManifold
symask = LBSkyMask(context=brep, density="3", center=pt, projection="Stereographic")  # -> report, context_mask, orient_mask, strategy_mask, sky_mask, context_view, orient_view, strategy_view, sky_view; plug-in component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
move = Move(Geometry=symask.context_mask, Motion="0,0,0.5")  # -> Geometry, Transform

# ----
# SunPath and Radiation Dome
skydome = LBSkyDome(sky_mtx=matrix, center_pt=pt, projection="Stereographic", legend_par=legendpar)  # -> report, mesh, compass, legend, title, patch_vecs, patch_values, mesh_values; plug-in component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
sunpath = LBSunPath(location=importepw.location, center_pt=pt, scale=1, projection="Stereographic")  # -> report, vectors, altitudes, azimuths, hoys, sun_pts, analemma, daily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; plug-in component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
geo = Geometry([skydome.mesh, skydome.legend])
