# Grasshopper definition radiation_rose_with_context.gh (Grasshopper 1.0.7)
# Copyright: I'll just come fight ya lawyers are tedious

panel = Panel("https://climate.onebuilding.org/WMO_Region_4_North_and_Central_America/USA_United_States_of_America/FL_Florida/USA_FL_NAS.Jacksonville-Towers.Field.722065_TMY3.zip")
downloadepw = LBDownloadWeather(weather_URL=panel)  # -> epw_file, stat_file, ddy_file; plug-in component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
importepw = LBImportEPW(epw_file=downloadepw.epw_file)  # -> location, dry_bulb_temperature, dew_point_temperature, relative_humidity, wind_speed, wind_direction, direct_normal_rad, diffuse_horizontal_rad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; plug-in component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
skymatrix = LBCumulativeSkyMatrix(location=importepw.location, direct_rad=importepw.direct_normal_rad, diffuse_rad=importepw.diffuse_horizontal_rad)  # -> out, sky_mtx; plug-in component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
construct_point = ConstructPoint(XCoordinate=Slider(0, range=0..100), YCoordinate=Slider(88, range=0..100), ZCoordinate=Slider(0, range=0..100))
brep = Brep([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])
brep_wireframe = BrepWireframe(Brep=brep, Density=-1)
radrose = LBRadiationRose(sky_mtx=skymatrix.sky_mtx, context=flatten(brep), center_pt=construct_point, arrow_scale=1)  # -> out, mesh, compass, orient_lines, legend, title, dir_vecs, dir_values, vis_set; plug-in component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
custom_preview = CustomPreview(Geometry=flatten(brep_wireframe), Material=ColourSwatch(SwatchColor=RGB(0, 0, 0)))
