# Grasshopper definition radiation_study.gh (Grasshopper 1.0.7)

# ----
# Import Weather Data
panel = Panel("http://climate.onebuilding.org/WMO_Region_4_North_and_Central_America/USA_United_States_of_America/WI_Wisconsin/USA_WI_Madison-Dane.County.Rgnl.AP-Truax.Field.726410_TMY3.zip")
downloadepw = LBDownloadWeather(weather_URL=panel)  # -> epw_file, stat_file, ddy_file; plug-in component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
importepw = LBImportEPW(epw_file=downloadepw.epw_file)  # -> location, dry_bulb_temperature, dew_point_temperature, relative_humidity, wind_speed, wind_direction, direct_normal_rad, diffuse_horizontal_rad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; plug-in component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
importstat = LBImportSTAT(stat_file=downloadepw.stat_file)  # -> location, ashrae_zone, koppen_zone, clear_dir_norm_rad, clear_diff_horiz_rad, ann_heat_dday_996, ann_heat_dday_990, ann_cool_dday_004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; plug-in component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

# ----
# Summer Design Day
# Radiation
panel_2 = Panel("21")
analysisperiod = LBAnalysisPeriod(start_month="7", start_day=panel_2, start_hour=0, end_month="7", end_day=panel_2)  # -> period, hoys, dates; plug-in component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
skymatrix = LBCumulativeSkyMatrix(
    north="20",
    location=importstat.location,
    direct_rad=importstat.clear_dir_norm_rad,
    diffuse_rad=importstat.clear_diff_horiz_rad,
    hoys=analysisperiod.hoys)  # -> report, sky_mtx; plug-in component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

# ----
# Annual Radiation
# Benefit/Harm
panel_3 = Panel("20")
benefitmatrix = LBBenefitSkyMatrix(
    north=panel_3,
    location=importepw.location,
    temperature=importepw.dry_bulb_temperature,
    direct_rad=importepw.direct_normal_rad,
    diffuse_rad=importepw.diffuse_horizontal_rad)  # -> report, sky_mtx; plug-in component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

# ----
# Annual Radiation
panel_4 = Panel("20")
skymatrix_2 = LBCumulativeSkyMatrix(
    north=panel_4,
    location=importepw.location,
    direct_rad=importepw.direct_normal_rad,
    diffuse_rad=importepw.diffuse_horizontal_rad)  # -> report, sky_mtx; plug-in component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

# ----
# Visualize Sky Matrix
toggle = BooleanToggle(False)
skydome = LBSkyDome(sky_mtx=skymatrix_2.sky_mtx, irradiance=toggle)  # -> report, mesh, compass, legend, title, patch_vecs, patch_values, mesh_values; plug-in component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

# ---- group: Run Me!
toggle_2 = BooleanToggle(False)

# ----
# Run Radiation Study
geo = Geometry(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)
geo_2 = Geometry(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)
incidentradiation = LBIncidentRadiation(
    sky_mtx=skymatrix_2.sky_mtx,
    geometry=flatten(geo),
    context=flatten(geo_2),
    grid_size="1",
    offset_dist="0.1",
    run=toggle_2)  # -> report, points, results, total, mesh, legend, title, int_mtx; plug-in component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

xmatrix = LBDeconstructMatrix(matrix=flatten(skymatrix_2.sky_mtx))  # -> values; plug-in component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
panel_5 = Panel(xmatrix)
meshselector = LBMeshThresholdSelector(values=incidentradiation.results, mesh=incidentradiation.mesh, pct_threshold=Slider(55, range=0..100))  # -> report, total_value, total_area, sub_mesh, outline; plug-in component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
radiation_in_threshold_kwh = Panel(meshselector.total_value)
