# Grasshopper definition shadow_effect_of_one_building.gh (Grasshopper 1.0.7)

# ----
# Import Location from EPW File
panel = Panel("http://climate.onebuilding.org/WMO_Region_4_North_and_Central_America/USA_United_States_of_America/WI_Wisconsin/USA_WI_Madison-Dane.County.Rgnl.AP-Truax.Field.726410_TMY3.zip")
downloadepw = LBDownloadWeather(weather_URL=panel)  # -> epw_file, stat_file, ddy_file; plug-in component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
importloc = LBImportLocation(epw_file=downloadepw.epw_file)  # -> location; plug-in component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

hoy = LBCalculateHOY(month=Slider(1, range=1..12), hour=Slider(14, range=0..23))  # -> flatten(hoy), flatten(doy), flatten(date); plug-in component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

# ----
# Create Sunpath
panel_2 = Panel("20")
sunpath = LBSunPath(north=panel_2, location=importloc, hoys=hoy.hoy, scale="3")  # -> report, vectors, altitudes, azimuths, hoys, sun_pts, analemma, daily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; plug-in component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

# ---- group: Run Me!
toggle = BooleanToggle(False)

# ----
geo = Geometry([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])
geo_2 = Geometry(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)

# ----
# Shadow Study of
# One Building
toggle_2 = BooleanToggle(True)
directsunhours = LBDirectSunHours(
    vectors=flatten(sunpath.vectors),
    geometry=flatten(geo),
    context=flatten(geo_2),
    grid_size="10",
    offset_dist="0.1",
    geo_block=toggle_2,
    run=toggle)  # -> report, points, results, mesh, legend, title, int_mtx; plug-in component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

# ----
# Shadow Study of
# All Buildings
directsunhours_2 = LBDirectSunHours(
    vectors=flatten(sunpath.vectors),
    geometry=flatten(geo),
    context=flatten(geo_2),
    grid_size="10",
    offset_dist="0.1",
    run=toggle)  # -> report, points, results, mesh, legend, title, int_mtx; plug-in component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

edges = BrepEdges(Brep=[geo, geo_2])  # -> Naked, Interior, NonManifold

panel_3 = Panel("""Building
Shade
Sun""")
panel_4 = Panel("""0.5
1.5""")
legendparcategorized = LBLegendParametersCategorized(
    domain=panel_4,
    colors=[ColourSwatch(SwatchColor=RGB(191, 0, 0)), ColourSwatch(SwatchColor=RGB(102, 100, 100)), ColourSwatch(SwatchColor=RGB(212, 212, 212))],
    categories=panel_3)  # -> leg_par; plug-in component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

addition = Addition(A=directsunhours_2.results, B=directsunhours.results)
heatmap = LBSpatialHeatmap(values=addition, mesh=directsunhours_2.mesh, legend_par=legendparcategorized)  # -> mesh, legend, title, colors, legend_par, vis_set; plug-in component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
