# Grasshopper definition solar_envelope.gh (Grasshopper 1.0.7)

# ----
# Donwload EPW
panel = Panel("https://energyplus-weather.s3.amazonaws.com/north_and_central_america_wmo_region_4/USA/NY/USA_NY_New.York-LaGuardia.AP.725030_TMY/USA_NY_New.York-LaGuardia.AP.725030_TMY.zip")
downloadepw = LBDownloadWeather(weather_URL=panel)  # -> epw_file, stat_file, ddy_file; plug-in component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
importepw = LBImportEPW(epw_file=downloadepw.epw_file)  # -> location, dry_bulb_temperature, dew_point_temperature, relative_humidity, wind_speed, wind_direction, direct_normal_rad, diffuse_horizontal_rad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; plug-in component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

# ----
# Base Surface
# (our site)
# Surrounding
# buildings
# Ground
# plane
ground = Brep(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)
srf = Surface(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)
contextgeo = Brep([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])
preview = CustomPreview(Geometry=srf, Shader=ColourSwatch(SwatchColor=RGB(236, 147, 81)))
preview_2 = CustomPreview(Geometry=contextgeo, Shader=ColourSwatch(SwatchColor=RGB(0, 80, 240)))
preview_3 = CustomPreview(Geometry=ground, Shader=ColourSwatch(SwatchColor=RGBA(122, 116, 92, 187)))

# ----
# Select Hours to Analyze
number_slider = Slider(6, range=0..23)
series = Series(Start=Slider(10, range=0..23), Step=1, Count=number_slider)
series_2 = Series(Start="1", Step=1, Count="12")
hoy = LBCalculateHOY(month=series_2, hour=graft(series))  # -> flatten(hoy), flatten(doy), flatten(date); plug-in component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

# ----
# Select Top and Bottom Surfaces
debrep = DeconstructBrep(Brep=contextgeo)  # -> Faces, Edges, Vertices
pi = Pi(Factor=1)
Z = UnitZ(Factor=1)
evalsrf = EvaluateSurface(Surface=debrep.Faces, Point="0,0")  # -> Point, Normal, UDirection, VDirection, Frame
angle = Angle(VectorA=evalsrf.Normal, VectorB=Z)  # -> Angle, Reflex
smaller = SmallerThan(FirstNumber=angle.Angle, SecondNumber="0.1")  # -> SmallerThan, OrEqualTo
subtraction = Subtraction(A=pi, B="0.1")
larger = LargerThan(FirstNumber=angle.Angle, SecondNumber=subtraction)  # -> LargerThan, OrEqualTo
dispatch = Dispatch(List=debrep.Faces, DispatchPattern=smaller.SmallerThan)  # -> flatten(ListA), ListB
dispatch_2 = Dispatch(List=debrep.Faces, DispatchPattern=larger.LargerThan)  # -> flatten(ListA), ListB
bottom_surfaces = Geometry(dispatch_2.ListA)
top_surfaces = Geometry(dispatch.ListA)

# ----
# Select Sun Vectors
panel_2 = Panel("a < 16")
pt = Point(Point(0, -1.783963043, 0))
sunpath = LBSunPath(location=importepw.location, hoys=hoy.hoy, center_pt=pt, scale=1, data=importepw.dry_bulb_temperature, statement=panel_2)  # -> report, vectors, altitudes, azimuths, hoys, sun_pts, analemma, daily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; plug-in component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

# ----
# Solar Rights Envelope
toggle = BooleanToggle(True)
solarenvelope = LBSolarEnvelope(
    geometry=flatten(srf),
    obstacles=flatten(bottom_surfaces),
    vectors=flatten(sunpath.vectors),
    grid_size="2.5",
    solar_rights=toggle,
    run=Toggle(False))  # -> report, points, mesh; plug-in component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

# ----
# Solar Collection Envelope
toggle_2 = BooleanToggle(False)
solarenvelope_2 = LBSolarEnvelope(
    geometry=flatten(srf),
    obstacles=flatten(top_surfaces),
    vectors=flatten(sunpath.vectors),
    grid_size="2.5",
    solar_rights=toggle_2,
    run=Toggle(False))  # -> report, points, mesh; plug-in component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
