# Grasshopper definition view_rose.gh (Grasshopper 1.0.7)

pedestrian_path = Curve(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)

pt = Point(Point(779.6494285, -238.9860409, 0))
legendpar = LBLegendParameters(min="0", max="300", num_decimals="0", base_plane=pt, seg_height="50")  # -> leg_par; plug-in component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

context_gometry = Geometry([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])
move = Move(Geometry=pedestrian_path, Motion="0, 0, 1")  # -> Geometry, Transform
curvepoint = PointOnCurve(move.Geometry, parameter=0.54)
mjoin = MeshJoin(Meshes=flatten(context_gometry))
edges = BrepEdges(Brep=context_gometry)  # -> Naked, Interior, NonManifold
viewrose = LBViewRose(context=mjoin, center_pt=curvepoint, radius="300", view_type="1", resolution="2", legend_par=legendpar)  # -> report, view_vecs, results, mesh, legend; plug-in component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
avr = Average(Input=viewrose.results)
medges = MeshEdges(Mesh=viewrose.mesh)  # -> NakedEdges, InteriorEdges, NonManifoldEdges
relative_distance_of_openness = Panel(avr)
preview = CustomPreview(Geometry=[medges.NakedEdges, medges.InteriorEdges], Material=ColourSwatch(SwatchColor=RGB(0, 0, 0)))
