# Grasshopper definition views_for_LEED.gh (Grasshopper 1.0.7)

window_head_height_model_units = Panel("9.5")
exterior_windows = Geometry([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])

# ----
# LEED VERSION
# LEED v4 INPUTS
list = ValueList({"LEED v3": 0, "LEED v4": 1}, selected="LEED v4")

view_resolution = Panel("3")
grid_size_rhino_model_units = Panel("1")
opaque_building_elements = Geometry([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])
# INPUTS
view_analysis_surface = Geometry([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])

# ----
# RUN THE STUDY!
toggle = BooleanToggle(False)

# ----
# Run a Radial View Study
panel = Panel("30")
legendpar = LBLegendParameters(max=panel, num_decimals="0")  # -> leg_par; plug-in component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
viewpercent = LBViewPercent(
    view_type="0",
    resolution=view_resolution,
    geometry=flatten(view_analysis_surface),
    context=flatten(opaque_building_elements),
    grid_size=grid_size_rhino_model_units,
    offset_dist="0.01",
    legend_par=legendpar,
    run=toggle)  # -> report, points, view_vecs, results, mesh, legend, title, int_mtx; plug-in component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

edges = BrepEdges(Brep=opaque_building_elements)  # -> Naked, Interior, NonManifold
# Calculate Passing Criteria for LEED v4
xmatrix = LBDeconstructMatrix(matrix=flatten(viewpercent.int_mtx))  # -> values; plug-in component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

# ----
# Calculate Passing Criteria for LEED v3
panel_2 = Panel("0")
equals = Equality(FirstNumber=flatten(viewpercent.results), SecondNumber=panel_2)  # -> Equality, Inequality

srf_cp = SurfaceClosestPoint(Point=flatten(viewpercent.points), Surface=graft(exterior_windows))  # -> Point, UVPoint, Distance
flip = FlipMatrix(Data=srf_cp.Distance)
python = PythonScript(ptIsVisible=xmatrix)  # -> flatten(multipleLinesOfSight); inputs ptIsVisible: list of Int32
# ---------- python: Python ----------
degCutoff = len(ptIsVisible)/4
multipleLinesOfSight = False
viewFound = -1

for i, view in enumerate(ptIsVisible):
    if view == 1:
        if viewFound == -1:
            viewFound = i
        else:
            if i - viewFound > degCutoff:
                multipleLinesOfSight = True
# ---------- end python ----------
sort = SortList(Keys=flip)  # -> Keys, ValuesA
item = ListItem(List=sort.Keys, Index=0, Wrap=True)  # -> flatten(Item)
multiplication = Multiplication(A=window_head_height_model_units, B="3")
smaller = SmallerThan(FirstNumber=item, SecondNumber=multiplication)  # -> SmallerThan, OrEqualTo
and = GateAnd(A=flatten(equals.Inequality), B=flatten(smaller.SmallerThan))
views_with_multiple_lines_of_sight = Boolean(python)
views_with_3x_head_height = Boolean(and)
and_2 = GateAnd(A=views_with_3x_head_height, B=views_with_multiple_lines_of_sight)

# ----
# Display the Criteria for Right LEED Version
leed_v3_views_to_the_outdoors = Boolean(equals.Inequality)
leed_v4_views_to_the_outdoors = Boolean(and_2)
gate = StreamGate(Stream=leed_v4_views_to_the_outdoors, Gate=list)  # -> Target0, Target1
gate_2 = StreamGate(Stream=leed_v3_views_to_the_outdoors, Gate=list)  # -> Target0, Target1
passing_failureresults = Data([gate_2.Target0, gate.Target1])

legendpar_2 = LBLegendParameters(colors=[ColourSwatch(SwatchColor=RGB(255, 0, 0)), ColourSwatch(SwatchColor=RGB(76, 212, 78))])  # -> leg_par; plug-in component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
# Make a Visualization of
# Passing and Failing Areas
viewsresults = Integer(flatten(passing_failureresults))
heatmap = LBSpatialHeatmap(values=viewsresults, mesh=viewpercent.mesh, legend_par=legendpar_2)  # -> mesh, legend, title, colors, legend_par, vis_set; plug-in component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

# ----
# Determine Whether you Pass LEED
analysis_surfaces = Brep(view_analysis_surface)
viewsresults_2 = Boolean(passing_failureresults)
view_mesh = Mesh(viewpercent.mesh)
leed_version = Data(list)

# ----
# Turn Preview
# on here to see
# the Areas that
# Pass and Fail
# LEED Criteria
leed_pass_fail_visual = Geometry(heatmap.mesh)

cullf = CullFaces(Mesh=view_mesh, Pattern=viewsresults_2)
panel_3 = Panel(""" v3
 v4""")
area = Area(Geometry=analysis_surfaces)  # -> flatten(Area), Centroid
area_2 = Area(Geometry=cullf)  # -> flatten(Area), Centroid
item_2 = ListItem(List=panel_3, Index=leed_version, Wrap=True)
ma = MassAddition(Input=area.Area)  # -> Result, PartialResults
ma_2 = MassAddition(Input=area_2.Area)  # -> Result, PartialResults
panel_4 = Panel("""90
75""")
item_3 = ListItem(List=panel_4, Index=leed_version, Wrap=True)
concat = Concatenate(FragmentA="You have passed LEED", FragmentB=item_2)
concat_2 = Concatenate(FragmentA="You have not passed LEED", FragmentB=item_2)

subtraction = Subtraction(A=ma.Result, B=ma_2.Result)

division = Division(A=subtraction, B=ma.Result)
multiplication_2 = Multiplication(A=division, B="100")
larger = LargerThan(FirstNumber=multiplication_2, SecondNumber=item_3)  # -> LargerThan, OrEqualTo
expression = Expression(x=multiplication_2, Expression="Round(x,1)")
dispatch = Dispatch(List=concat_2, DispatchPattern=larger.LargerThan)  # -> ListA, ListB
dispatch_2 = Dispatch(List=concat, DispatchPattern=larger.LargerThan)  # -> ListA, ListB
data = Data([dispatch_2.ListA, dispatch.ListB])
concat_3 = Concatenate(FragmentA=expression, FragmentB="%")

leed_status = Panel(data)
percent_with_view_to_the_outdoors = Panel(concat_3)
