# Grasshopper definition visibility_study.gh (Grasshopper 1.0.7)

geo = Geometry(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)
geo_2 = Geometry(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)

pt = Point([Point(43.27220448, 75.63940783, 0), Point(18.11837315, 75.63940783, 0), Point(57.2307907, 52.88681413, 0)])

# ---- group: Run Me!
toggle = BooleanToggle(False)

# ----
visibilitypercent = LBVisibilityPercent(view_points=pt, geometry=flatten(geo), context=flatten(geo_2), grid_size="2", offset_dist="0.1", run=toggle)  # -> report, points, results, mesh, legend, title, int_mtx; plug-in component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
