# Grasshopper definition visualization_set.gh (Grasshopper 1.0.7)

# ----
# Import Weather Data Location
panel = Panel("https://energyplus-weather.s3.amazonaws.com/north_and_central_america_wmo_region_4/USA/NY/USA_NY_New.York-J.F.Kennedy.Intl.AP.744860_TMY3/USA_NY_New.York-J.F.Kennedy.Intl.AP.744860_TMY3.zip")
downloadepw = LBDownloadWeather(weather_URL=panel)  # -> epw_file, stat_file, ddy_file; plug-in component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
importepw = LBImportEPW(epw_file=downloadepw.epw_file)  # -> location, dry_bulb_temperature, dew_point_temperature, relative_humidity, wind_speed, wind_direction, direct_normal_rad, diffuse_horizontal_rad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; plug-in component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

legendpar = LBLegendParameters(min="12", max="22", num_decimals="0", vert_or_horiz=Toggle(False))  # -> leg_par; plug-in component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

analysisperiod = LBAnalysisPeriod(start_month="5", start_day="21", start_hour=0, end_month="5", end_day="21")  # -> period, hoys, dates; plug-in component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

sunpath = LBSunPath(
    location=importepw.location,
    hoys=analysisperiod.hoys,
    scale=1,
    data=importepw.dry_bulb_temperature,
    legend_par=legendpar)  # -> report, vectors, altitudes, azimuths, hoys, sun_pts, analemma, daily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; plug-in component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

# ----
# Add 2D Screen-Oriented Text
panel_2 = Panel("90%")
legend2d = LBLegend2DParameters(origin_y=panel_2)  # -> leg_par2d; plug-in component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
text2d = LBScreenOrientedText(text=sunpath.title, leg_par2d=legend2d, viewport="Perspective")  # plug-in component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

# ----
# Preview VisualizationSet in Rhino
legend2d_2 = LBLegend2DParameters()  # -> leg_par2d; plug-in component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
visset = LBPreviewVisualizationSet(vis_set=flatten(sunpath.vis_set), leg_par2d=legend2d_2, viewport="Perspective")  # -> vs; plug-in component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

# ----
# Write VisualizationSet to a SVG
toggle = BooleanToggle(True)
dumpvisset = LBDumpVisualizationSet(vis_set=visset, svg_view="SE", svg_width="1000", svg_height="1000", legend_2d=toggle, dump=Toggle(False))  # -> report, vs_file; plug-in component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
openfile = LBOpenFile(file_path=dumpvisset.vs_file)  # -> report; plug-in component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
