# Grasshopper definition windrose_plot.gh (Grasshopper 1.0.7)

panel = Panel("https://www.energyplus.net/weather-download/asia_wmo_region_2/CHN//CHN_Beijing.Beijing.545110_SWERA/all")
panel_2 = Panel("http://climate.onebuilding.org/WMO_Region_4_North_and_Central_America/CAN_Canada/ON_Ontario/CAN_ON_Toronto.Pearson.Intl.AP.716240_CWEC.zip")
panel_3 = Panel("https://www.energyplus.net/weather-download/north_and_central_america_wmo_region_4/USA/PA/USA_PA_Philadelphia.724086_TMY2/all")
downloadepw = LBDownloadWeather(weather_URL=panel)  # -> epw_file, stat_file, ddy_file; plug-in component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
downloadepw_2 = LBDownloadWeather(weather_URL=panel_2)  # -> epw_file, stat_file, ddy_file; plug-in component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
downloadepw_3 = LBDownloadWeather(weather_URL=panel_3)  # -> epw_file, stat_file, ddy_file; plug-in component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
importepw = LBImportEPW(epw_file=downloadepw.epw_file)  # -> location, dry_bulb_temperature, dew_point_temperature, relative_humidity, wind_speed, wind_direction, direct_normal_rad, diffuse_horizontal_rad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; plug-in component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
importepw_2 = LBImportEPW(epw_file=downloadepw_3.epw_file)  # -> location, dry_bulb_temperature, dew_point_temperature, relative_humidity, wind_speed, wind_direction, direct_normal_rad, diffuse_horizontal_rad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; plug-in component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
importepw_3 = LBImportEPW(epw_file=downloadepw_2.epw_file)  # -> location, dry_bulb_temperature, dew_point_temperature, relative_humidity, wind_speed, wind_direction, direct_normal_rad, diffuse_horizontal_rad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; plug-in component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
legendpar = LBLegendParameters()  # -> leg_par; plug-in component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
windrose = LBWindRosePlot(
    wind_speed=[importepw.wind_speed, importepw_3.wind_speed, importepw_2.wind_speed],
    wind_direction=[importepw.wind_direction, importepw_3.wind_direction, importepw_2.wind_direction],
    dir_count=Slider(16, range=0..20),
    show_calmrose=Toggle(False),
    show_freq=Toggle(True),
    freq_hours=Slider(60, range=0..100),
    legend_par=legendpar)  # -> report, mesh, compass, orient_lines, freq_lines, legend, title; plug-in component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
geo = Geometry(windrose.freq_lines)
geo_2 = Geometry([windrose.mesh, windrose.compass, windrose.legend, windrose.title])
